# Grasshopper definition 12_toolpaths.gh (Grasshopper 1.0.8)

# ----
# Elements
# Beams to be joined
number_slider = Slider(1, range=0..1)
# joining elements
# by category
number_slider_2 = Slider(2, range=0..10)
geo = Geometry([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])
geo_2 = Geometry([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])
ct_beam = CTBeam(centerline=geo_2, width=number_slider, height=number_slider_2, category="outer")  # -> Beam, Blank; inputs centerline: list, z_vector: list of Vector3d, width: list of Double, height: list of Double, category: list of String, updateRefObj: Boolean
#   port centerline: Referenced curve or line, Guid of curve or line in the active Rhino document.
#   port z_vector: Vector defining the orientation of the cross-section (corresponds to the height dimension). If None, a default will be taken.
#   port width: Width of the cross-section (usually the smaller dimension).
#   port height: Height of the cross-section (usually the larger dimension).
#   port category: Category of a beam.
#   port updateRefObj: (optional) If True, the attributes in the referenced object will be updated/overwritten with the new values given here.
#   port Beam: Beam object(s).
#   port Blank: Shape of the beam's blank.
# ---------- ct_beam: Python ----------
# r: compas_timber==1.0.1
# venv: sw25
"""Creates a Beam from a LineCurve."""

# flake8: noqa
import Grasshopper
import Rhino
import rhinoscriptsyntax as rs
import System
from compas.scene import Scene
from compas_rhino.conversions import line_to_compas
from compas_rhino.conversions import vector_to_compas

from compas_timber.elements import Beam as CTBeam
from compas_timber.ghpython.rhino_object_name_attributes import update_rhobj_attributes_name
from compas_timber.ghpython.ghcomponent_helpers import list_input_valid_cpython


class Beam_fromCurve(Grasshopper.Kernel.GH_ScriptInstance):
    def RunScript(self,
            centerline: System.Collections.Generic.List[object],
            z_vector: System.Collections.Generic.List[Rhino.Geometry.Vector3d],
            width: System.Collections.Generic.List[float],
            height: System.Collections.Generic.List[float],
            category: System.Collections.Generic.List[str],
            updateRefObj: bool):
        # minimum inputs required
        if not list_input_valid_cpython(ghenv, centerline, "Centerline"):
            return
        if not width:
            length = self._get_centerline_length(centerline)
            width = [length / 20]
        if not height:
            length = self._get_centerline_length(centerline)
            height = [length / 10]

        # reformat unset parameters for consistency
        if not z_vector:
            z_vector = [None]
        if not category:
            category = [None]

        beams = []
        blanks = []
        scene = Scene()

        if centerline and height and width:
            # check list lengths for consistency
            N = len(centerline)
            if len(z_vector) not in (0, 1, N):
                ghenv.Component.AddRuntimeMessage(
                    Grasshopper.Kernel.GH_RuntimeMessageLevel.Error, " In 'ZVector' I need either none, one or the same number of inputs as the Crv parameter."
                )
            if len(width) not in (1, N):
                ghenv.Component.AddRuntimeMessage(Grasshopper.Kernel.GH_RuntimeMessageLevel.Error, " In 'W' I need either one or the same number of inputs as the Crv parameter.")
            if len(height) not in (1, N):
                ghenv.Component.AddRuntimeMessage(Grasshopper.Kernel.GH_RuntimeMessageLevel.Error, " In 'H' I need either one or the same number of inputs as the Crv parameter.")
            if len(category) not in (0, 1, N):
                ghenv.Component.AddRuntimeMessage(
                    Grasshopper.Kernel.GH_RuntimeMessageLevel.Error, " In 'Category' I need either none, one or the same number of inputs as the Crv parameter."
                )

            # duplicate data if None or single value
            if len(z_vector) != N:
                z_vector = [z_vector[0] for _ in range(N)]
            if len(width) != N:
                width = [width[0] for _ in range(N)]
            if len(height) != N:
                height = [height[0] for _ in range(N)]
            if len(category) != N:
                category = [category[0] for _ in range(N)]

            for line, z, w, h, c in zip(centerline, z_vector, width, height, category):
                guid, geometry = self._get_guid_and_geometry(line)
                rhino_line = rs.coerceline(geometry)
                line = line_to_compas(rhino_line)

                z = vector_to_compas(z) if z else None
                beam = CTBeam.from_centerline(centerline=line, width=w, height=h, z_vector=z)
                beam.attributes["rhino_guid"] = str(guid) if guid else None
                beam.attributes["category"] = c
                if updateRefObj and guid:
                    update_rhobj_attributes_name(guid, "width", str(w))
                    update_rhobj_attributes_name(guid, "height", str(h))
                    update_rhobj_attributes_name(guid, "zvector", str(list(beam.frame.zaxis)))
                    update_rhobj_attributes_name(guid, "category", c)

                beams.append(beam)
                scene.add(beam.blank)

        blanks = scene.draw()

        return beams, blanks

    def _get_guid_and_geometry(self, line):
        # internalized curves and GH geometry will not have persistent GUIDs, referenced Rhino objects will
        # type hint on the input has to be 'ghdoc' for this to work
        guid = None
        geometry = line
        rhino_obj = Rhino.RhinoDoc.ActiveDoc.Objects.FindId(line)
        if rhino_obj:
            guid = line
            geometry = rhino_obj.Geometry
        return guid, geometry

    def _get_centerline_length(self, centerline):
        centerline_length = []
        for i in centerline:
            centerline_length.append(rs.CurveLength(i))
        if centerline_length:
            length_average = sum(centerline_length) / len(centerline_length)
        else:
            length_average = 1
        return length_average
# ---------- end ct_beam ----------
ct_beam_2 = CTBeam(centerline=geo, width=Slider(1, range=0..1), height=Slider(2, range=0..10), category="inner")  # -> Beam, Blank; inputs centerline: list, z_vector: list of Vector3d, width: list of Double, height: list of Double, category: list of String, updateRefObj: Boolean; same code as ct_beam

data = Data([ct_beam.Beam, ct_beam_2.Beam])

# ----
# Joint Definition
# (right click component to select/change joint type)
panel = Panel("inner")
toggle = BooleanToggle(True)
ct_category_joints_rules = CTCategoryJointsRules(main_beam_category=panel, cross_beam_category="outer")  # -> TStepJoint; inputs main_beam_category: String, cross_beam_category: String
#   port main_beam_category: Beam A category.
#   port cross_beam_category: Beam B category.
#   port TStepJoint: A joint rule.
# ---------- ct_category_joints_rules: Python ----------
# r: compas_timber>=1.0.1
"""Defines which Joint type will be applied in the Automatic Joints component for connecting Beams with the given Category attributes. This overrides Topological Joint rules and is overriden by Direct joint rules"""

# flake8: noqa
import inspect
from collections import OrderedDict

import Grasshopper
from System.Windows.Forms import ToolStripMenuItem
from System.Windows.Forms import ToolStripSeparator


from compas_timber.design import CategoryRule
from compas_timber.ghpython import get_createable_joints
from compas_timber.ghpython import item_input_valid_cpython
from compas_timber.ghpython import manage_cpython_dynamic_params
from compas_timber.ghpython import rename_cpython_gh_output
from compas_timber.ghpython import warning
from compas_timber.ghpython import message


class CategoryJointRule(Grasshopper.Kernel.GH_ScriptInstance):
    def __init__(self):
        super(CategoryJointRule, self).__init__()
        self.topo_bools = OrderedDict([("Unknown", False), ("I", False), ("L", False), ("T", False), ("X", False)])

        self.classes = {}
        for cls in get_createable_joints():
            self.classes[cls.__name__] = cls

        if ghenv.Component.Params.Output[0].NickName == "Rule":
            self.joint_type = None
        else:
            parsed_output = ghenv.Component.Params.Output[0].NickName.split("_")
            self.joint_type = self.classes.get(parsed_output[0])
            for key in parsed_output[1:]:
                self.topo_bools[key] = True

    @property
    def component(self):
        return ghenv.Component  # type: ignore

    def RunScript(self, *args):
        if not self.joint_type:
            warning(self.component, "Select joint type from context menu (right click)")
            return None
        else:
            message(self.component, self.joint_type.__name__)
            cat_a, cat_b = args[:2]
            kwargs = {}
            for i, val in enumerate(args[2:]):
                if val is not None:
                    kwargs[self.arg_names()[i + 2]] = val
            if not item_input_valid_cpython(ghenv, cat_a, self.arg_names()[0]) or not item_input_valid_cpython(ghenv, cat_b, self.arg_names()[1]):
                return

            topos = []
            for i, bool in enumerate(self.topo_bools.values()):
                if bool:
                    topos.append(i)

            return CategoryRule(self.joint_type, cat_a, cat_b, topos, **kwargs)

    def arg_names(self):
        names = inspect.getargspec(self.joint_type.__init__)[0][1:]
        for i in range(2):
            names[i] += "_category"
        return [name for name in names if (name != "key") and (name != "frame")] + ["max_distance"]

    def AppendAdditionalMenuItems(self, menu):
        for name in self.classes.keys():
            item = menu.Items.Add(name, None, self.on_item_click)
            if self.joint_type and name == self.joint_type.__name__:
                item.Checked = True

        menu.Items.Add(ToolStripSeparator())
        topo_menu = ToolStripMenuItem("Apply to Topology")
        menu.Items.Add(topo_menu)
        for name, bool in self.topo_bools.items():
            item = ToolStripMenuItem(name, None, self.on_topo_click)
            item.Checked = bool
            topo_menu.DropDownItems.Add(item)

    def output_name(self):
        name = self.joint_type.__name__
        for key, bool in self.topo_bools.items():
            if bool:
                name += "_{}".format(key)
        return name

    def on_topo_click(self, sender, event_info):
        self.topo_bools[str(sender)] = not self.topo_bools[str(sender)]
        rename_cpython_gh_output(self.output_name(), 0, ghenv)
        ghenv.Component.ExpireSolution(True)

    def on_item_click(self, sender, event_info):
        self.joint_type = self.classes[str(sender)]
        rename_cpython_gh_output(self.output_name(), 0, ghenv)
        manage_cpython_dynamic_params(self.arg_names(), ghenv, rename_count=2, permanent_param_count=0)
        ghenv.Component.ExpireSolution(True)
# ---------- end ct_category_joints_rules ----------
ct_category_joints_rules_2 = CTCategoryJointsRules(main_beam_category="inner", cross_beam_category="inner", cut_plane_bias=Slider(0.3, range=0..1))  # -> XLapJoint; inputs main_beam_category: String, cross_beam_category: String; same code as ct_category_joints_rules

ct_category_joints_rules_3 = CTCategoryJointsRules(beam_a_category="outer", beam_b_category="outer")  # -> LMiterJoint; inputs beam_a_category: String, beam_b_category: String; same code as ct_category_joints_rules
data_2 = Data([ct_category_joints_rules, ct_category_joints_rules_2, ct_category_joints_rules_3])

number_slider_3 = Slider(7.6, range=0.1..20.1)  # disabled
number_slider_4 = Slider(0.246, range=-0.5..0.5)  # disabled
number_slider_5 = Slider(6, range=3..20)  # disabled
number_slider_6 = Slider(0.4, range=-0.5..9.5)  # disabled
number_slider_7 = Slider(2.168, range=0..10)  # disabled
rf_unit = Python3Script(
    sides=number_slider_5,
    radius=number_slider_3,
    start_eccentricity=number_slider_6,
    end_eccentricity=number_slider_4,
    overlap=number_slider_7)  # -> segment_lines, shape_edges; inputs sides: Int32; disabled
# ---------- rf_unit: Python ----------
# r: compas_timber==1.0.1
# venv: sw25

from compas_rhino.devtools import DevTools
DevTools.ensure_path()

from compas.geometry import Polygon
from compas_rhino.conversions import line_to_rhino_curve

from rfunits import RFUnit

# Create a polygon
polygon = Polygon.from_sides_and_radius_xy(sides, radius)

# Create RF unit
unit = RFUnit(polygon, start_eccentricity=start_eccentricity, end_eccentricity=end_eccentricity, overlap=overlap)
unit.generate_segments()
unit.adjust_segments()

shape_edges = [line_to_rhino_curve(edge) for edge in unit.edges]
segment_lines = [line_to_rhino_curve(segment.line) for segment in unit.segments]
# ---------- end rf_unit ----------

# ----
# Model
# where joinery takes place
toggle_2 = BooleanToggle(True)
ct_model = CTModel(Elements=flatten(data), JointRules=flatten(data_2), CreateGeometry=toggle_2)  # -> Model, Geometry, DebugInfo; inputs Elements: list, Containers: list, JointRules: list, Features: list, MaxDistance: Double, CreateGeometry: Boolean
#   port Elements: Collection of Beams
#   port Containers: Container elements, such as walls, floors, roofs, etc.
#   port JointRules: Collection of joint rules.
#   port Features: Collection of feature definitions.
#   port MaxDistance: Max Distance Tolerance for topology detection.
#   port CreateGeometry: If True, Beam and joint geometry is created for visualization.
#   port Model: Model object.
#   port Geometry: Geometry of the beams and joints.
#   port DebugInfo: Debug information object in the case of feature or joining errors.
# ---------- ct_model: Python ----------
# r: compas_timber>=1.0.1
"""Creates an Model"""

import Grasshopper
import Rhino
import System
from compas.scene import Scene
from compas.tolerance import TOL
from compas.tolerance import Tolerance

from compas_timber.design import DebugInfomation
from compas_timber.design import JointRuleSolver
from compas_timber.design import WallPopulator
from compas_timber.elements import Beam
from compas_timber.elements import Plate
from compas_timber.errors import FeatureApplicationError
from compas_timber.ghpython import error
from compas_timber.ghpython import warning
from compas_timber.model import TimberModel

# workaround for https://github.com/gramaziokohler/compas_timber/issues/280
TOL.absolute = 1e-6


class ModelComponent(Grasshopper.Kernel.GH_ScriptInstance):
    @property
    def component(self):
        return ghenv.Component  # type: ignore

    def RunScript(self,
            Elements: System.Collections.Generic.List[object],
            Containers: System.Collections.Generic.List[object],
            JointRules: System.Collections.Generic.List[object],
            Features: System.Collections.Generic.List[object],
            MaxDistance: float,
            CreateGeometry: bool):
        # this used to be default behavior in Rhino7.. I think..
        Elements = Elements or []
        Containers = Containers or []
        JointRules = JointRules or []
        Features = Features or []

        if not Elements:
            warning(self.component, "Input parameter Beams failed to collect data")
        if not JointRules:
            warning(self.component, "Input parameter JointRules failed to collect data")
        if not (Elements or Containers):  # shows beams even if no joints are found
            return
        if MaxDistance is None:
            MaxDistance = TOL.ABSOLUTE  # compared to calculted distance, so shouldn't be just 0.0

        tol = self.get_tol()
        Model = TimberModel(tolerance=tol)
        debug_info = DebugInfomation()

        ##### Adding elements #####
        self.add_elements_to_model(Model, Elements, Containers)

        ##### Wall populating #####
        handled_pairs, wall_joints = self.handle_populators(Model, Containers, MaxDistance)

        ##### Handle joinery #####
        # checks elements compatibility and generates Joints
        JointRules = [j for j in JointRules if j is not None]

        solver = JointRuleSolver(JointRules, max_distance=MaxDistance)
        joint_errors, _ = solver.apply_rules_to_model(Model)  # TODO: figure out best way to pass out unjoined_clusters

        for je in joint_errors:
            debug_info.add_joint_error(je)

        # applies extensions and features resulting from joints
        bje = Model.process_joinery()
        if bje:
            debug_info.add_joint_error(bje)

        ##### Handle user features #####
        if Features:
            feature_errors = self.handle_features(Features)
            debug_info.add_feature_error(feature_errors)

        ##### Visualization #####
        Geometry, errors = self.handle_geometry(Model, CreateGeometry)
        for geo_error in errors:
            debug_info.add_feature_error(geo_error)

        ##### Error Handling #####
        if debug_info.has_errors:
            warning(self.component, "Error found during joint creation. See DebugInfo output for details.")

        return Model, Geometry, debug_info

    def get_tol(self):
        units = Rhino.RhinoDoc.ActiveDoc.GetUnitSystemName(True, True, True, True)
        if units == "m":
            return Tolerance(unit="M", absolute=1e-6, relative=1e-6)
        elif units == "mm":
            return Tolerance(unit="MM", absolute=1e-3, relative=1e-3)
        else:
            error(self.component, f"Unsupported unit: {units}")
            return

    def add_elements_to_model(self, model, elements, containers):
        """Adds elements to the model and groups them by slab."""
        elements = [e for e in elements if e is not None]
        for element in elements:
            element.reset()
            model.add_element(element)

        containers = [c for c in containers if c is not None]

        for index, c_def in enumerate(containers):
            slab = c_def.slab
            model.add_group_element(slab, name=slab.name + str(index))

    def handle_populators(self, model, containers, max_distance):
        # Handle wall populators
        model.connect_adjacent_walls()
        config_sets = [c_def.config_set for c_def in containers]
        populators = []
        if any(config_sets):
            populators = WallPopulator.from_model(model, config_sets)

        handled_pairs = []
        wall_joints = []
        for populator, slab in zip(populators, list(model.slabs)):
            elements = populator.create_elements()
            model.add_elements(elements, parent=slab.name)
            joint_definitions = populator.create_joints(elements, max_distance)
            wall_joints.extend(joint_definitions)
            for j_def in joint_definitions:
                element_a, element_b = j_def.elements
                handled_pairs.append({element_a, element_b})

        return handled_pairs, wall_joints

    def handle_features(self, features):
        feature_errors = []
        features = [f for f in features if f is not None]
        for f_def in features:
            if not f_def.elements:
                warning(self.component, "Features defined in model must have elements defined. Features without elements will be ignored")
                continue

            for element in f_def.elements:
                try:
                    element.add_features(f_def.feature_from_element(element))
                except FeatureApplicationError as ex:
                    feature_errors.append(ex)
        return feature_errors

    def handle_geometry(self, Model, CreateGeometry):
        scene = Scene()
        errors = []
        for element in Model.elements():
            if CreateGeometry:
                scene.add(element.geometry)
                if getattr(element, "debug_info", False):
                    errors.append(element.debug_info)
            else:
                if isinstance(element, Beam):
                    scene.add(element.blank)
                elif isinstance(element, Plate):
                    scene.add(element.shape)
                else:
                    scene.add(element.geometry)
        return scene.draw(), errors
# ---------- end ct_model ----------

unit_x = UnitX(Factor=1)  # disabled
rotate_3d = Rotate3D(Geometry=rf_unit.segment_lines, Angle=0.471238898, Center=Point(0, 0, 0), Axis=unit_x)  # -> Geometry, Transform; disabled
script = Script(x=rotate_3d.Transform)  # -> out, a; inputs x: list; disabled
# ---------- script: Python ----------
import Rhino.Geometry as rg
print(type(x))
x = x[0]
a = rg.Vector3d(x.M02, x.M12, x.M22)
# ---------- end script ----------

number_slider_8 = Slider(0.749, range=0.01..1.1)  # disabled
number_slider_9 = Slider(0.6, range=0.01..5.01)  # disabled
boolean_toggle = BooleanToggle(True)  # disabled
unit_z = UnitZ(Factor=1)  # disabled
ct_model_2 = Python3Script(
    lines=rotate_3d.Geometry,
    width=number_slider_8,
    height=number_slider_9,
    z_vector=script.a,
    process_joinery=boolean_toggle)  # -> model, geo; inputs lines: list of Line, z_vector: Vector3d; disabled
# ---------- ct_model_2: Python ----------
# r: compas_timber==1.0.1
# venv: sw25

from compas_rhino.conversions import line_to_compas
from compas_rhino.conversions import vector_to_compas
from compas_timber.connections import XLapJoint, TButtJoint
from compas_timber.elements import Beam
from compas_timber.model import TimberModel

# 1. Convert the Z vector from Rhino to COMPAS
z_vector = vector_to_compas(z_vector)

# 2. Create a new TimberModel()
model = TimberModel()

# 3. For each input line...
for line in lines:
    # 4. Convert the line to COMPAS and create a Beam.from_centerline() for it
    beam = Beam.from_centerline(line_to_compas(line), width, height, z_vector)
    # 5. Add the beam to the model
    model.add_element(beam)


# 6. Iterate over model's beams in pairs (wrapping around the last element)
beams = list(model.beams)
num_beams = len(beams)

for i in range(num_beams):
    beam_a = beams[i]
    beam_b = beams[(i + 1) % len(beams)]
    # 7. And create joints between each pair. Choose TButtJoint or XLapJoint types.
    # TButtJoint.create(model, beam_a, beam_b)
    XLapJoint.create(model, beam_a, beam_b, True, cut_plane_bias=0.1)

# 8. Process all joinery
if process_joinery:
    model.process_joinery()

# 9. Output the beams' geometry for visualization
geo = []
for beam in model.beams:
    geo.append(beam.geometry.native_brep)
# ---------- end ct_model_2 ----------

# ----
# Machining
# convert processings to machine-ready data
number_slider_10 = Slider(2, range=0..10)
machining_side = ValueList({"Auto": -1, "0", "1", "2", "3"}, selected="Auto")
file_path = FilePath()
toolpath = Script(
    model=ct_model.Model,
    beam_key=number_slider_10,
    machining_side=machining_side,
    tool_radius=Slider(0.19, range=0.01..1),
    stepdown=Slider(0.1, range=0.1..2),
    stepsize=Slider(0.02, range=0.01..2),
    approach_height=Slider(1, range=0.01..10),
    flip_direction=Toggle(True),
    enable_rotation=Toggle(False),
    selected_processing=Slider(0, range=0..10))  # -> out, beam_at_origin, processing_geo_at_origin, toolpath, machining_ref_frame, slices, slicing_frames; inputs beam_key: Int32, machining_side: Int32, selected_processing: Int32
# ---------- toolpath: Python ----------
# r: compas_timber==1.0.1
# venv: sw25

from compas_rhino.devtools import DevTools
DevTools.ensure_path()

import math
from compas.geometry import Line
from compas.geometry import Transformation
from compas.geometry import Rotation
from compas_rhino.conversions import frame_to_rhino_plane
from timber_toolpaths import get_toolpath_from_processing

beams = {b.key: b for b in model.beams}
selected_beam = beams[beam_key]
ref_frame = selected_beam.frame.copy()

if enable_rotation:
    rotation_per_refside = {0: 180, 1: 0, 2: 0, 3: 0}
    ref_frame.rotate(math.radians(rotation_per_refside[machining_side]), ref_frame.xaxis, ref_frame.point)

machining_transformation = Transformation.from_frame(ref_frame).inverse()
beam_at_origin = selected_beam.geometry.transformed(machining_transformation)

f = selected_beam.ref_sides[machining_side]
machining_ref_frame = frame_to_rhino_plane(f.transformed(machining_transformation))


# Get toolpaths
print(f"Beam {selected_beam.key} has {len(selected_beam.features)} features")
current_processing_count = 0
for feature in selected_beam.features:
    print(f" - {type(feature)}")

    results = get_toolpath_from_processing(
        selected_beam,
        feature,  # processing
        machining_transformation,
        tool_radius=tool_radius,
        stepdown=stepdown,
        min_step=stepsize,
        # divisions=20,
        flip_direction=flip_direction,
        approach_height=approach_height,
        machining_side=machining_side
    )

    if results:
        if selected_processing == current_processing_count:
            if results[0] == "subtraction":
                _result_type, toolpath, processing_geo_at_origin, slices, slicing_frames = results
                slicing_frames = list(map(frame_to_rhino_plane, slicing_frames))
            elif results[0] == "cut":
                _result_type, toolpath, processing_geo_at_origin, slices = results

            toolpath = list(map(frame_to_rhino_plane, toolpath))

        # Keep track of how many processing we actually
        # supported and generated toolpaths for
        current_processing_count += 1
# ---------- end toolpath ----------
ct_writebtlx = CTWriteBTLx(model=ct_model.Model, path=file_path, write=Button())  # -> BTLx; inputs write: Boolean
#   port model: Model object.
#   port path: Filepath for new BTLx.
#   port write: Write to file.
#   port BTLx: Pretty BTLx string
# ---------- ct_writebtlx: Python ----------
"""Writes a BTLx file for machining of model parts."""
# r: compas_timber>=1.0.1
# flake8: noqa
import Grasshopper
import Rhino

from compas_timber.fabrication import BTLxWriter
from compas_timber.ghpython.ghcomponent_helpers import item_input_valid_cpython


class WriteBTLx(Grasshopper.Kernel.GH_ScriptInstance):
    def RunScript(self, model, path, write: bool):
        if not item_input_valid_cpython(ghenv, model, "Model"):
            return

        btlx = BTLxWriter(file_name=str(Rhino.RhinoDoc.ActiveDoc.Name))

        if write:
            if not item_input_valid_cpython(ghenv, path, "Path"):
                return
            XML = btlx.write(model, path)
        else:
            XML = btlx.model_to_xml(model)

        return XML
# ---------- end ct_writebtlx ----------
tool_path_frames = Geometry(toolpath.toolpath)
compas_draw = COMPASDraw(cg=toolpath.beam_at_origin)  # -> rg
#   port cg: The COMPAS geometry or datastructure to be drawn.
#   port rg: The Rhino geometry object.
# ---------- compas_draw: Python ----------
# r: compas>=2.14.1
"""
Draws COMPAS geometry in Grasshopper.
"""

from typing import Any

import Grasshopper

from compas.scene import SceneObject


class CompasToRhinoGeometry(Grasshopper.Kernel.GH_ScriptInstance):
    def RunScript(self, cg):
        if not cg:
            return None

        return SceneObject(item=cg).draw()
# ---------- end compas_draw ----------
compas_draw_2 = COMPASDraw(cg=toolpath.processing_geo_at_origin)  # -> rg; same code as compas_draw
deconstruct_plane = DeconstructPlane(Plane=tool_path_frames)  # -> Origin, XAxis, YAxis, ZAxis
shift_list = ShiftList(List=deconstruct_plane.Origin, Shift=1, Wrap=False)
line = Line(StartPoint=deconstruct_plane.Origin, EndPoint=shift_list)

# ---- group: This is needed only ONCE in the GH definition to enable VS Code reloading
auto_reload = Python3Script()  # -> ok
# ---------- auto_reload: Python ----------
"""
------------------------------
Using VS Code as Python editor
------------------------------

The simplest way to start using VS Code as our editor, is
to place our Python code in files located IN THE SAME FOLDER as our Grasshopper file.

After we have done that, we need 2 steps: 

1. Enable the COMPAS reloader on one component. This tells Grasshopper to watch for changes in the Pythoh files and reload if changed.
2. Every other component that uses Python code from external files needs to start with a method to ensure Grasshopper knows where to load the files from.

"""
# r: compas_timber==1.0.1
# venv: sw25

from compas_rhino.devtools import DevTools
DevTools.enable_reloader()
# ---------- end auto_reload ----------

# ----
panel_2 = Panel(toolpath.out)

# ---- group: Debug
compas_draw_3 = COMPASDraw(cg=toolpath.slices)  # -> rg; same code as compas_draw
geometry = Geometry(toolpath.machining_ref_frame)
geometry_2 = Geometry(toolpath.slicing_frames)
split_list = SplitList(List=line, Index=Slider(0, range=0..10000))  # -> ListA, ListB
geometry_3 = Geometry(split_list.ListA)

# ----
split_list_2 = SplitList(List=compas_draw_3, Index=Slider(0, range=0..100))  # -> ListA, ListB
geometry_4 = Geometry(split_list_2.ListA)
